# Grasshopper definition grippers_corals_2_params.gh (Grasshopper 1.0.8)

py3 = Python3Script()  # -> out, a
# ---------- py3: Python ----------
import rhinoscriptsyntax as rs
import scriptcontext
import Rhino
import os
import math 

def cargar_y_bakear_subd_desde_archivo(ruta):
    """Carga un SubD desde un archivo .3dm y lo bakea en RhinoDoc.
       Retorna el ID del objeto bakeado (GUID)."""

    modelo = Rhino.FileIO.File3dm.Read(ruta)
    subds = []

    for obj in modelo.Objects:
        if isinstance(obj.Geometry, Rhino.Geometry.SubD):
            subds.append(obj.Geometry)

    if not subds:
        print("No se encontró ningún SubD en el archivo:", ruta)
        return None

    subd = subds[0]

    gh_doc_backup = scriptcontext.doc

    scriptcontext.doc = Rhino.RhinoDoc.ActiveDoc

    attr = Rhino.DocObjects.ObjectAttributes()
    attr.Name = "Coral_SubD"

    subd_id = scriptcontext.doc.Objects.AddSubD(subd, attr)

    scriptcontext.doc = gh_doc_backup

    print("SubD cargado y bakeado. ID:", subd_id)
    return subd_id


# coral path
ruta_subd = r"C:\\coral.3dm"

coral_subd_id = cargar_y_bakear_subd_desde_archivo(ruta_subd)

#Grippers

lado_cubo = 10
altura_cubo = 10
radio_agujero = 2

mirror_angle_degrees = 72
central_cylinder_offset = 0
origin_xy_distance_offset = 0

arc_amplitude_factors_to_test = [0.1, 0.11, 0.12, 0.13, 0.14]
arc_offset_ys_to_test = [2, 2.5, 3, 3.5, 4]
arc_resolution_points = 30

output_dir = "C:\\prueba_corales"
if not os.path.exists(output_dir):
    os.makedirs(output_dir)

mirror_angle_radians = math.radians(mirror_angle_degrees)
mirror_plane = Rhino.Geometry.Plane(
    Rhino.Geometry.Point3d.Origin,
    Rhino.Geometry.Vector3d(
        math.cos(mirror_angle_radians),
        math.sin(mirror_angle_radians),
        0
    )
)

# Parametric design

for arc_param in range(42, 45, 5):

    for arc_amplitude_factor in arc_amplitude_factors_to_test:

        for arc_offset_y in arc_offset_ys_to_test:

            try:
                scriptcontext.doc = Rhino.RhinoDoc.ActiveDoc

                # points
                p1 = Rhino.Geometry.Point3d(5, 0, 0)
                p2 = Rhino.Geometry.Point3d(lado_cubo * 2, 0, 0)
                p3 = Rhino.Geometry.Point3d(arc_param, 0, 0)
                p4 = Rhino.Geometry.Point3d(arc_param, 7, 0)
                p5 = Rhino.Geometry.Point3d(lado_cubo * 2, lado_cubo, 0)
                p6 = Rhino.Geometry.Point3d(5, lado_cubo, 0)

                line1 = Rhino.Geometry.Line(p1, p2).ToNurbsCurve()
                # parabolic arc
                horizontal_dist = abs(p3.X - p2.X)
                arc1_peak_y = horizontal_dist * arc_amplitude_factor + arc_offset_y

                parabola_vertex_x = (p2.X + p3.X) / 2
                if horizontal_dist == 0:
                    parabola_a = 0
                else:
                    parabola_a = -arc1_peak_y / ((p2.X - parabola_vertex_x) ** 2)

                arc1_points = Rhino.Collections.Point3dList()
                arc1_points.Add(p2)

                for i in range(1, arc_resolution_points - 1):
                    t = float(i) / (arc_resolution_points - 1)
                    current_x = p2.X * (1 - t) + p3.X * t
                    current_y = parabola_a * (current_x - parabola_vertex_x) ** 2 + arc1_peak_y
                    arc1_points.Add(Rhino.Geometry.Point3d(current_x, current_y, 0))

                arc1_points.Add(p3)

                arc1 = Rhino.Geometry.NurbsCurve.CreateControlPointCurve(arc1_points, 3)
                if not arc1:
                    raise Exception("Error creando arc1 parabólico.")

                # curves
                line2 = Rhino.Geometry.Line(p3, p4).ToNurbsCurve()
                arc2 = Rhino.Geometry.Arc(p4, Rhino.Geometry.Point3d((p4.X + p5.X) / 2, 15, 0), p5).ToNurbsCurve()
                line3 = Rhino.Geometry.Line(p5, p6).ToNurbsCurve()
                line4 = Rhino.Geometry.Line(p6, p1).ToNurbsCurve()

                joined_curves = Rhino.Geometry.Curve.JoinCurves([line1, arc1, line2, arc2, line3, line4])
                if not joined_curves:
                    raise Exception("Error al unir curvas.")

                gripper_curve = joined_curves[0]
                extrusion = Rhino.Geometry.Extrusion.Create(gripper_curve, altura_cubo, True)
                extrusion_brep = extrusion.ToBrep()

                # Shaft hole
                centro_cil = Rhino.Geometry.Point3d(p1.X + (p2.X - p1.X) / 2, lado_cubo / 2, 0)
                cilindro = Rhino.Geometry.Cylinder(Rhino.Geometry.Circle(centro_cil, radio_agujero), altura_cubo).ToBrep(True, True)

                resultado = Rhino.Geometry.Brep.CreateBooleanDifference([extrusion_brep], [cilindro], 0.01)
                if not resultado:
                    raise Exception("Falló boolean.")

                original_id = scriptcontext.doc.Objects.AddBrep(resultado[0])

                mirrored = resultado[0].Duplicate()
                mirrored.Transform(Rhino.Geometry.Transform.Mirror(mirror_plane.Origin, mirror_plane.Normal))
                mirrored_id = scriptcontext.doc.Objects.AddBrep(mirrored)

                layer_name = "Gripper_Layer"
                if not rs.IsLayer(layer_name):
                    rs.AddLayer(layer_name)

                rs.ObjectLayer(original_id, layer_name)
                rs.ObjectLayer(mirrored_id, layer_name)

                if coral_subd_id:
                    rs.ObjectLayer(coral_subd_id, layer_name)

                # Export
                objects_to_export = [original_id, mirrored_id]
                if coral_subd_id:
                    objects_to_export.append(coral_subd_id)

                objects_to_export = [x for x in objects_to_export if x]

                step_filename = f"gripper_arc_{arc_param}_amp_{arc_amplitude_factor:.2f}_off_{arc_offset_y:.2f}_coral.step"
                step_filepath = os.path.join(output_dir, step_filename)

                rs.Command("_SelNone", echo=False)
                for obj_id in objects_to_export:
                    rs.Command(f"-_SelID {obj_id}", echo=False)

                export_cmd = f'-_Export "{step_filepath}" _Enter'
                rs.Command(export_cmd, echo=True)
                rs.Command("_SelNone", echo=False)

                print("STEP exportado:", step_filepath)

            except Exception as e:
                print(f"ERROR: {e}")

            finally:
                if 'ghdoc' in globals() and ghdoc:
                    scriptcontext.doc = ghdoc
                else:
                    rs.Command("_SelNone", echo=False)
# ---------- end py3 ----------
