# Grasshopper definition grippers_corals_4_params.gh (Grasshopper 1.0.8)

py3 = Python3Script()  # -> out, a
# ---------- py3: Python ----------
"""Grasshopper Script Instance"""
import System
import Rhino
import Grasshopper
import rhinoscriptsyntax as rs
import scriptcontext
import os
import math

class MyComponent(Grasshopper.Kernel.GH_ScriptInstance):
    def RunScript(self, x, y):
        # Coral position
        
        coral_move_x = 20.0  
        coral_move_y = -5.0  

        
        def cargar_y_preparar_coral(path, move_x, move_y):
            if not os.path.exists(path):
                print("File not found:", path)
                return None
            
            modelo = Rhino.FileIO.File3dm.Read(ruta)
            subds = [obj.Geometry for obj in modelo.Objects if isinstance(obj.Geometry, Rhino.Geometry.SubD)]
            
            if not subds: return None
            
            subd_geom = subds[0].Duplicate()
            
            # Crear vector de movimiento y aplicar transformación
            translation_vector = Rhino.Geometry.Vector3d(move_x, move_y, 0)
            transformation = Rhino.Geometry.Transform.Translation(translation_vector)
            subd_geom.Transform(transformation)
            
            # Cambiar contexto para añadir a RhinoDoc
            original_doc = scriptcontext.doc
            scriptcontext.doc = Rhino.RhinoDoc.ActiveDoc
            
            attr = Rhino.DocObjects.ObjectAttributes()
            attr.Name = "Coral_Transformado"
            subd_id = scriptcontext.doc.Objects.AddSubD(subd_geom, attr)
            
            scriptcontext.doc = original_doc
            return subd_id

        ruta_coral = r"C:\\coral.3dm"
        coral_id = cargar_y_preparar_coral(ruta_coral, coral_move_x, coral_move_y)

        
        # Grippers
        lado_cubo = 10
        altura_cubo = 10
        radio_agujero = 2
        mirror_angle_degrees = 75 
        
        parabolic_amplitudes_to_test = [0.05, 0.10, 0.15]
        parabolic_offsets_to_test = [1, 2, 3]
        sine_amplitudes_to_test = [0.2, 0.4, 0.6]
        sine_frequencies_to_test = [3.0, 6.0, 9.0]
        arc_resolution_points = 30
        
        output_dir = "C:/set_corals"
        if not os.path.exists(output_dir): os.makedirs(output_dir)

        mirror_angle_radians = math.radians(mirror_angle_degrees)
        mirror_plane = Rhino.Geometry.Plane(
            Rhino.Geometry.Point3d.Origin,
            Rhino.Geometry.Vector3d(math.cos(mirror_angle_radians), math.sin(mirror_angle_radians), 0)
        )

        for arc_param in range(60, 80, 5):
            for p_amp in parabolic_amplitudes_to_test:
                for p_off in parabolic_offsets_to_test:
                    for s_amp in sine_amplitudes_to_test:
                        for s_freq in sine_frequencies_to_test:
                            
                            try:
                                scriptcontext.doc = Rhino.RhinoDoc.ActiveDoc
                                
                                p1 = Rhino.Geometry.Point3d(5, 0, 0)
                                p2 = Rhino.Geometry.Point3d(lado_cubo * 2, 0, 0)
                                p3 = Rhino.Geometry.Point3d(arc_param, 0, 0)
                                p4 = Rhino.Geometry.Point3d(arc_param, 7, 0)
                                p5 = Rhino.Geometry.Point3d(lado_cubo * 2, lado_cubo, 0)
                                p6 = Rhino.Geometry.Point3d(5, lado_cubo, 0)

                                line1 = Rhino.Geometry.Line(p1, p2).ToNurbsCurve()
                                length_x = p3.X - p2.X
                                arc1_pts = Rhino.Collections.Point3dList()
                                arc1_pts.Add(p2)
                                
                                if length_x > 0:
                                    v_x = (p2.X + p3.X) / 2
                                    peak_y = (length_x * p_amp) + p_off
                                    a_coeff = -peak_y / ((p2.X - v_x)**2)
                                    for i in range(1, arc_resolution_points - 1):
                                        t = float(i) / (arc_resolution_points - 1)
                                        curr_x = p2.X + t * length_x
                                        y_p = a_coeff * (curr_x - v_x)**2 + peak_y
                                        y_s = s_amp * math.sin(t * 2 * math.pi * s_freq)
                                        arc1_pts.Add(Rhino.Geometry.Point3d(curr_x, y_p + y_s, 0))
                                
                                arc1_pts.Add(p3)
                                arc1 = Rhino.Geometry.NurbsCurve.CreateControlPointCurve(arc1_pts, 3)


                                l2 = Rhino.Geometry.Line(p3, p4).ToNurbsCurve()
                                a2 = Rhino.Geometry.Arc(p4, Rhino.Geometry.Point3d((p4.X+p5.X)/2, 15, 0), p5).ToNurbsCurve()
                                l3 = Rhino.Geometry.Line(p5, p6).ToNurbsCurve()
                                l4 = Rhino.Geometry.Line(p6, p1).ToNurbsCurve()

                                joined = Rhino.Geometry.Curve.JoinCurves([line1, arc1, l2, a2, l3, l4])[0]
                                ext_brep = Rhino.Geometry.Extrusion.Create(joined, altura_cubo, True).ToBrep()

                                # shaft hole
                                c_agujero = Rhino.Geometry.Point3d(p1.X + (p2.X - p1.X) / 2, lado_cubo / 2, 0)
                                cortador = Rhino.Geometry.Cylinder(Rhino.Geometry.Circle(c_agujero, radio_agujero), altura_cubo).ToBrep(True, True)
                                res_bool = Rhino.Geometry.Brep.CreateBooleanDifference([ext_brep], [cortador], 0.01)

                                g1_id = scriptcontext.doc.Objects.AddBrep(res_bool[0])
                                m_brep = res_bool[0].Duplicate()
                                m_brep.Transform(Rhino.Geometry.Transform.Mirror(mirror_plane.Origin, mirror_plane.Normal))
                                g2_id = scriptcontext.doc.Objects.AddBrep(m_brep)

                                step_name = "GR_arc{}_pa{:.2f}_po{:.1f}_sa{:.2f}_sf{:.1f}.step".format(
                                    arc_param, p_amp, p_off, s_amp, s_freq)
                                step_path = os.path.join(output_dir, step_name)

                                ids_to_export = [g1_id, g2_id]
                                if coral_id: ids_to_export.append(coral_id)

                                rs.Command("_SelNone", echo=False)
                                for obj_id in ids_to_export:
                                    rs.Command("-_SelID " + str(obj_id), echo=False)
                                
                                rs.Command('-_Export "{}" _Enter'.format(step_path), echo=False)
                                
                                scriptcontext.doc.Objects.Delete(g1_id, True)
                                scriptcontext.doc.Objects.Delete(g2_id, True)

                            except Exception as e:
                                print("Error: " + str(e))
                            
                            finally:
                                if 'ghdoc' in globals(): scriptcontext.doc = ghdoc

        print("Finish export: " + output_dir)
        return
# ---------- end py3 ----------
