# Grasshopper definition grippers_cylinder_4_params.gh (Grasshopper 1.0.8)

python_3_script = Python3Script()  # -> out, a
# ---------- python_3_script: Python ----------
"""Grasshopper Script Instance"""
import System
import Rhino
import Grasshopper

import rhinoscriptsyntax as rs
import rhinoscriptsyntax as rs
import scriptcontext
import Rhino
import os
import math # Import the math module for trigonometric calculations


class MyComponent(Grasshopper.Kernel.GH_ScriptInstance):
    def RunScript(self, x, y):
        # --- MODEL PARAMETERS ---
        # Define cube size and extrusion height
        lado_cubo = 10
        altura_cubo = 10
        radio_agujero = 2
        
        # Define the mirror angle around the Z-axis (in degrees)
        # For example:
        # 0 degrees: Mirror through the YZ plane (X=0)
        # 45 degrees: Mirror at a 45-degree angle with respect to the YZ plane, rotating around the Z-axis
        # 90 degrees: Mirror through the XZ plane (Y=0)
        mirror_angle_degrees = 75 # <--- ADJUSTED ANGLE!
        
        # Central cylinder offset from the midpoint base (related to p2 and p3) along the symmetry axis.
        # A positive value will move it in the direction of the symmetry axis (away from the origin if the symmetry axis is in the first quadrant).
        # A negative value will move it in the opposite direction (closer to the origin if the symmetry axis is in the first quadrant).
        central_cylinder_offset = 0 # <--- ADJUST THIS VALUE FOR THE DESIRED OFFSET ALONG THE SYMMETRY AXIS!
        
        # Additional offset to move the central cylinder away from/closer to the origin, applied at the end.
        # A positive value will move the cylinder away from the origin along the symmetry axis.
        # A negative value will move it closer to the origin along the symmetry axis.
        # A value of 0 will maintain the position without this additional offset.
        origin_xy_distance_offset = 0 # <--- ADJUST THIS VALUE TO MOVE IT AWAY FROM/CLOSER TO THE ORIGIN!
        
        # Parameters for the base PARABOLIC curve
        # Lists of values to iterate through for combinations
        parabolic_amplitudes_to_test = [0.05, 0.10, 0.15] # <--- ADJUST THESE FACTORS FOR PARABOLIC AMPLITUDE COMBINATIONS!
        parabolic_offsets_to_test = [1, 2, 3] # <--- ADJUST THESE VALUES FOR PARABOLIC VERTICAL OFFSET COMBINATIONS!
        
        # Parameters for the SINUSOIDAL wave added ON TOP of the parabolic curve
        # Lists of values to iterate through for combinations
        sine_amplitudes_to_test = [0.2, 0.4, 0.6] # <--- ADJUST THESE VALUES FOR SINE WAVE AMPLITUDE COMBINATIONS!
        sine_frequencies_to_test = [3.0, 6.0, 9.0] # <--- ADJUST THESE VALUES FOR SINE WAVE FREQUENCY COMBINATIONS (number of cycles within the segment)!
        
        # Number of points to define the NURBS curve for the parametric arc
        arc_resolution_points = 300 # <--- ADJUST THIS FOR THE SMOOTHNESS OF THE PARAMETRIC CURVE!
        
        # Output directory
        output_dir = "C:/prueba7"
        if not os.path.exists(output_dir):
            os.makedirs(output_dir)
        
        # --- SCRIPT START ---
        # Convert angle from degrees to radians for trigonometric functions
        mirror_angle_radians = math.radians(mirror_angle_degrees)
        
        # Define the mirror plane rotated around the Z-axis
        # The plane origin is (0,0,0).
        # The plane normal is calculated using cosine and sine of the angle,
        # which effectively rotates the normal vector (1,0,0) around the Z-axis.
        mirror_plane = Rhino.Geometry.Plane(
            Rhino.Geometry.Point3d.Origin,
            Rhino.Geometry.Vector3d(
                math.cos(mirror_angle_radians), # X component of the normal
                math.sin(mirror_angle_radians), # Y component of the normal
                0                               # Z component (does not change when rotating around Z)
            )
        )
        
        # Iterate over arc_param values from 60 to 120 in steps of 10
        for arc_param in range(60, 80, 5):
            # Nested loops for combinations of parabolic curve parameters
            for current_parabolic_amplitude in parabolic_amplitudes_to_test:
                for current_parabolic_offset in parabolic_offsets_to_test:
                    # Nested loops for combinations of sinusoidal wave parameters
                    for current_sine_amplitude in sine_amplitudes_to_test:
                        for current_sine_frequency in sine_frequencies_to_test:
                            try:
                                # Ensure the active document is Rhino's if not in a Grasshopper component
                                # This is important for adding objects to the document.
                                scriptcontext.doc = Rhino.RhinoDoc.ActiveDoc
                                
                                # IMPORTANT: Objects from previous iterations will NOT be deleted.
                                # All generated geometries will accumulate in the Rhino document.
        
                                # Define contour points with the variable parameter
                                p1 = Rhino.Geometry.Point3d(5, 0, 0)
                                p2 = Rhino.Geometry.Point3d(lado_cubo * 2, 0, 0)
                                p3 = Rhino.Geometry.Point3d(arc_param, 0, 0)
                                p4 = Rhino.Geometry.Point3d(arc_param, 7, 0)
                                p5 = Rhino.Geometry.Point3d(lado_cubo * 2, lado_cubo, 0)
                                p6 = Rhino.Geometry.Point3d(5, lado_cubo, 0)
        
                                # Create lines and arcs
                                line1 = Rhino.Geometry.Line(p1, p2).ToNurbsCurve()
        
                                # --- PARAMETRIC FUNCTION FOR ARC1 (p2 to p3) - COMBINED PARABOLA + SINUSOIDAL WAVE ---
                                arc1_points = Rhino.Collections.Point3dList()
                                arc1_points.Add(p2) # Ensure the curve starts at p2
        
                                length_x_segment = p3.X - p2.X
                                if length_x_segment <= 0:
                                    # Handle cases where p3.X is not greater than p2.X
                                    # In such cases, the parabolic and sinusoidal functions are ill-defined or flat.
                                    # We can simply create a straight line or handle it as an error.
                                    # For now, let's create a straight line to avoid crashing.
                                    arc1_points.Add(p3)
                                    arc1 = Rhino.Geometry.Line(p2, p3).ToNurbsCurve()
                                    # print(f"Warning: length_x_segment is zero or negative for arc_param={arc_param}. Creating straight line for arc1.")
                                else:
                                    # Calculate parabola parameters for this iteration
                                    parabola_vertex_x = (p2.X + p3.X) / 2
                                    # The peak of the parabola relative to the 0 Y-plane
                                    parabola_peak_y_base = (length_x_segment * current_parabolic_amplitude) + current_parabolic_offset
                                    
                                    # Calculate 'a' coefficient for the parabola y = a * (x - h)^2 + k
                                    parabola_a_coeff = -parabola_peak_y_base / ((p2.X - parabola_vertex_x)**2)
                                        
                                    # Generate intermediate points for the combined curve
                                    for i in range(1, arc_resolution_points - 1):
                                        t = float(i) / (arc_resolution_points - 1) # Parameter from 0 to 1
                                        current_x = p2.X + t * length_x_segment # Interpolate X linearly between p2.X and p3.X
                                        
                                        # 1. Calculate the Y value from the parabolic base function
                                        y_from_parabola = parabola_a_coeff * (current_x - parabola_vertex_x)**2 + parabola_peak_y_base
                                        
                                        # 2. Calculate the Y value from the sinusoidal component
                                        # The sine wave is added on top of the parabolic curve
                                        # (current_x - p2.X) / length_x_segment normalizes x from 0 to 1 over the segment
                                        sine_component_y = current_sine_amplitude * math.sin( (current_x - p2.X) / length_x_segment * 2 * math.pi * current_sine_frequency )
                                        
                                        # 3. Combine both components for the final Y coordinate
                                        current_y = y_from_parabola + sine_component_y
                                        
                                        arc1_points.Add(Rhino.Geometry.Point3d(current_x, current_y, 0))
        
                                    arc1_points.Add(p3) # Ensure the curve ends at p3
        
                                    # Create the NURBS curve from the generated points
                                    # Using a degree of 3 for a smooth curve. Adjust as needed (e.g., 2 for simple parabola)
                                    arc1 = Rhino.Geometry.NurbsCurve.CreateControlPointCurve(arc1_points, 3)
                                    if not arc1:
                                        raise Exception("Failed to create NURBS curve for arc1 (combined wave).")
                                # --- END PARAMETRIC FUNCTION FOR ARC1 ---
        
        
                                line2 = Rhino.Geometry.Line(p3, p4).ToNurbsCurve()
                                arc2 = Rhino.Geometry.Arc(p4, Rhino.Geometry.Point3d((p4.X + p5.X) / 2, 15, 0), p5).ToNurbsCurve()
                                line3 = Rhino.Geometry.Line(p5, p6).ToNurbsCurve()
                                line4 = Rhino.Geometry.Line(p6, p1).ToNurbsCurve()
        
                                # Join curves into a single closed curve
                                # JoinCurves returns a list of joined curves, we take the first [0]
                                joined_curves = Rhino.Geometry.Curve.JoinCurves([line1, arc1, line2, arc2, line3, line4])
                                if not joined_curves:
                                    raise Exception("Failed to join curves to form the gripper contour.")
                                gripper_curve = joined_curves[0]
                                if not gripper_curve.IsClosed:
                                    raise Exception("Gripper curve is not closed.")
        
                                # Create extrusion
                                extrusion = Rhino.Geometry.Extrusion.Create(gripper_curve, altura_cubo, True)
                                if not extrusion:
                                    raise Exception("Extrusion creation failed.")
                                extrusion_brep = extrusion.ToBrep()
                                if not extrusion_brep:
                                    raise Exception("Extrusion to Brep conversion failed.")
        
                                # Create cutting cylinder
                                # The cylinder's center adjusts to the middle of the gripper's base shape
                                centro_cilindro = Rhino.Geometry.Point3d(p1.X + (p2.X - p1.X) / 2, lado_cubo / 2, 0)
                                cilindro = Rhino.Geometry.Cylinder(Rhino.Geometry.Circle(centro_cilindro, radio_agujero), altura_cubo).ToBrep(True, True)
                                if not cilindro:
                                    raise Exception("Cutting cylinder creation failed.")
        
                                # Boolean difference operation
                                resultado = Rhino.Geometry.Brep.CreateBooleanDifference([extrusion_brep], [cilindro], 0.01)
        
                                if not resultado or len(resultado) == 0:
                                    raise Exception("Boolean operation failed or produced no results.")
        
                                # Add original brep to the document
                                original_id = scriptcontext.doc.Objects.AddBrep(resultado[0])
                                if not original_id:
                                    raise Exception("Failed to add original brep to the document.")
        
                                # Mirror the brep using the rotated plane
                                mirrored_brep = resultado[0].Duplicate()
                                if not mirrored_brep.Transform(Rhino.Geometry.Transform.Mirror(mirror_plane.Origin, mirror_plane.Normal)):
                                    raise Exception("Mirror transformation failed for the main brep.")
                                mirrored_id = scriptcontext.doc.Objects.AddBrep(mirrored_brep)
                                if not mirrored_id:
                                    raise Exception("Failed to add mirrored brep to the document.")
        
                                # --- CENTRAL CYLINDER ---
                                # The radius of the central cylinder must remain the same across all variations.
                                radio_cilindro_central = 12 # Fixed radius for the central cylinder
        
                                # Calculate the base radial distance from the origin, based on p2.X and p3.X.
                                # This sets the "position between p2 and p3" along the X-axis of the original gripper.
                                base_radial_distance = (p2.X + p3.X) / 2
        
                                # Apply the first offset along the symmetry axis.
                                # central_cylinder_offset shifts the cylinder from the base position.
                                distance_after_offset1 = base_radial_distance + central_cylinder_offset
        
                                # Apply the second offset, which is an additional adjustment of the distance from the origin.
                                # origin_xy_distance_offset moves the cylinder further from or closer to the origin along the symmetry axis.
                                final_radial_distance = distance_after_offset1 + origin_xy_distance_offset
        
                                # Calculate the X and Y coordinates of the new cylinder's center.
                                # Trigonometric functions with the mirror angle are used to ensure
                                # the cylinder is on the symmetry axis and at the calculated radial distance.
                                new_cylinder_center_x = final_radial_distance * math.sin(mirror_angle_radians)
                                new_cylinder_center_y = -final_radial_distance * math.cos(mirror_angle_radians)
        
                                # The Z coordinate of the central cylinder remains at 0 to keep it in the XY plane.
                                centro_cilindro_central = Rhino.Geometry.Point3d(new_cylinder_center_x, new_cylinder_center_y, 0)
        
                                # The height of the central cylinder.
                                altura_cilindro_central = altura_cubo
        
                                # Create the new central cylinder.
                                cilindro_central = Rhino.Geometry.Cylinder(Rhino.Geometry.Circle(centro_cilindro_central, radio_cilindro_central), altura_cilindro_central).ToBrep(True, True)
                                if not cilindro_central:
                                    raise Exception("Central cylinder creation failed.")
                                cilindro_central_id = scriptcontext.doc.Objects.AddBrep(cilindro_central)
                                if not cilindro_central_id:
                                    raise Exception("Failed to add central cylinder to the document.")
                                # --- END CENTRAL CYLINDER ---
        
                                # Taller cylinder inside the original gripper's hole
        
                                # Assign all geometries to the correct layer
                                layer_name = "Gripper_Layer"
                                if not rs.IsLayer(layer_name):
                                    rs.AddLayer(layer_name)
        
                                # Now all elements are assigned to the layer, including the central cylinder
                                for obj_id in [original_id, mirrored_id, cilindro_central_id]:
                                    if obj_id: # Ensure the ID is not None before attempting to change the layer
                                        rs.ObjectLayer(obj_id, layer_name)
        
                                # Export all geometries to a single STEP file
                                # Include all relevant parameters in the filename for unique identification
                                step_filename = (
                                    f"gripper_arc_{arc_param}"
                                    f"_paramp_{current_parabolic_amplitude:.2f}"
                                    f"_paroff_{current_parabolic_offset:.2f}"
                                    f"_sineamp_{current_sine_amplitude:.2f}"
                                    f"_sinefreq_{current_sine_frequency:.1f}"
                                    f"_angle_Z_{mirror_angle_degrees}.step"
                                )
                                step_filepath = os.path.join(output_dir, step_filename)
        
                                # Select all objects before exporting
                                objects_to_export = [original_id, mirrored_id, cilindro_central_id]
                                # Filter None in case of previous failures when adding objects
                                objects_to_export = [obj_id for obj_id in objects_to_export if obj_id]
        
                                if objects_to_export:
                                    # Deselect everything first
                                    rs.Command('_SelNone', echo=False)
                                    for obj_id in objects_to_export:
                                        rs.Command(f'-_SelID {obj_id}', echo=False) # Select by ID
        
                                    export_command = f'-_Export "{step_filepath}" _Enter'
                                    rs.Command(export_command, echo=True)
                                    rs.Command('_SelNone', echo=False) # Deselect after export
        
                                    print(
                                        f"STEP file saved for "
                                        f"arc_param={arc_param}, "
                                        f"parabolic_amplitude={current_parabolic_amplitude:.2f}, "
                                        f"parabolic_offset={current_parabolic_offset:.2f}, "
                                        f"sine_amplitude={current_sine_amplitude:.2f}, "
                                        f"sine_frequency={current_sine_frequency:.1f} "
                                        f"with {len(objects_to_export)} geometries: {step_filepath}"
                                    )
                                else:
                                    print(
                                        f"No objects generated for export in iteration for "
                                        f"arc_param={arc_param}, "
                                        f"parabolic_amplitude={current_parabolic_amplitude}, "
                                        f"parabolic_offset={current_parabolic_offset}, "
                                        f"sine_amplitude={current_sine_amplitude}, "
                                        f"sine_frequency={current_sine_frequency}."
                                    )
        
                            except Exception as e:
                                print(
                                    f"Error in iteration for "
                                    f"arc_param={arc_param}, "
                                    f"parabolic_amplitude={current_parabolic_amplitude}, "
                                    f"parabolic_offset={current_parabolic_offset}, "
                                    f"sine_amplitude={current_sine_amplitude}, "
                                    f"sine_frequency={current_sine_frequency}: {e}"
                                )
        
                            finally:
                                # Ensure Grasshopper document is restored if running in it
                                # ghdoc is a global variable in Grasshopper Python components.
                                if 'ghdoc' in globals() and ghdoc:
                                    scriptcontext.doc = ghdoc
                                else:
                                    # If not in Grasshopper, simply clear the selection
                                    rs.Command('_SelNone', echo=False)
        
        return

    # Solve overrides 
    def BeforeRunScript(self):
        pass

    def AfterRunScript(self):
        pass

    # Preview overrides 
    def get_ClippingBox(self):
        return Rhino.Geometry.BoundingBox.Empty

    def DrawViewportWires(self, args):
        pass
# ---------- end python_3_script ----------
